# Grasshopper definition BirdFlocking_GH_Simon.gh (Grasshopper 1.0.7)

panel = Panel("C:\Users\simon\Dropbox\ITECH 2018-2019\ComputationalDesign\Assignments\FinalAssignment\CompDesing_Birdflocking\BirdFlocking\BirdFlocking.py")
vec = VectorXYZ(
    XComponent=Slider(0.1, range=-100..100),
    YComponent=Slider(-23.4, range=-100..100),
    ZComponent=Slider(-24.7, range=-100..100))  # -> Vector, Length
pt = Point(Point(446.0288227, 127.8417792, 120.2952428))
file = ReadFile(File=panel, PerLineParse=False)
tag = TextTag(Location=pt, Text="Maultaschen")
number_slider = Slider(42.71, range=0..100)
pt_2 = Point(Point(161.6534791, 30.35037557, 8.048263508))
sph = Sphere(Base=pt_2, Radius=number_slider)
timer = Timer(TimerInterval=20, Target=python)
python = GhPythonScript(
    Code=file,
    IReset=Button(),
    IEnabled=Toggle(False),
    IAgentCount=Slider(162, range=0..1100),
    ISpeed=Slider(1.74, range=0..2),
    IFoodStrength=Slider(7.22, range=0..50),
    IFoodSource=pt,
    ISeparationStrength=Slider(35.99, range=0..70),
    ISeparationDistance=Slider(18.95, range=0..50),
    IDetectonDistance=Slider(17.6, range=0..100),
    IWindSpeed=vec.Vector,
    IObstacle=pt_2,
    ICollideStrength=Slider(3.21, range=0..10),
    IObstacleSize=number_slider)  # -> Out, OHistory, OPositions, OPositions2
crv = Curve(python.OHistory)
pt_3 = Point(python.OPositions)
preview = CustomPreview(Geometry=python.OPositions2, Material=ColourSwatch(SwatchColor=RGB(210, 250, 64)))
