# Grasshopper definition BirdFlocking_GH_v01_ts.gh (Grasshopper 1.0.7)

vec = VectorXYZ(
    XComponent=Slider(0.1, range=-100..100),
    YComponent=Slider(-23.4, range=-100..100),
    ZComponent=Slider(-24.7, range=-100..100))  # -> Vector, Length
path = FilePath("C:\Users\Tim Stark\Desktop\ITECH_CompDesign\FinalAssignment\BirdFlocking\BirdFlocking.py")
pt = Point(Point(446.0288227, 127.8417792, 120.2952428))
file = ReadFile(File=path, PerLineParse=False)
tag = TextTag(Location=pt, Text="Maultaschen")
panel = Panel("""40
20""")
panel_2 = Panel("""3
2""")
panel_3 = Panel(""".9
.9""")
number_slider = Slider(42.71, range=0..100)
# NEEDS TO BE RENAMED
# decide for test or not
pt_2 = Point(Point(161.6534791, 30.35037557, 8.048263508))
sph = Sphere(Base=pt_2, Radius=number_slider)
brep = Brep(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)
brep_2 = Brep([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])
crv = Curve([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])
timer = Timer(TimerInterval=20, Target=python)
python = GhPythonScript(
    Code=file,
    IReset=Button(),
    IEnabled=Toggle(False),
    IAgentCount=Slider(52, range=0..1100),
    ISpeed=Slider(1.74, range=0..2),
    IFoodStrength=Slider(7.22, range=0..50),
    IFoodSource=pt,
    ISeparationStrength=Slider(35.99, range=0..70),
    ISeparationDistance=Slider(18.95, range=0..50),
    IDetectonDistance=Slider(16, range=0..100),
    IWindSpeed=vec.Vector,
    IObstacle=pt_2,
    ICollideStrength=Slider(20, range=0..20),
    IObstacleSize=number_slider,
    IObstacleBreps=[sph, brep],
    IUpliftArea=brep_2,
    IUpliftStrength=panel_2,
    TestUpliftArea=crv,
    TestUpliftRadius=panel,
    TestRevolveStrength=panel_3,
    IPredatorCount=Slider(3, range=0..10),
    IPredatorRadius=Slider(78, range=0..100),
    IPredatorSpeed=Slider(2, range=1..10))  # -> Out, OBirdHistory, OBirdPositions, OPredatorHistory, OPredatorPositions
sph_2 = Sphere(Base=python.OPredatorPositions, Radius=2)
panel_4 = Panel(python.Out)
swatch = ColourSwatch(SwatchColor=RGB(255, 0, 64))
preview = CustomPreview(Geometry=sph_2, Material=swatch)
preview_2 = CustomPreview(Geometry=python.OPredatorHistory, Material=swatch)
preview_3 = CustomPreview(Geometry=python.OBirdHistory, Material=ColourSwatch(SwatchColor=RGB(210, 250, 64)))
preview_4 = CustomPreview(Geometry=python.OBirdPositions, Material=ColourSwatch(SwatchColor=RGB(25, 21, 48)))
